# Grasshopper definition Design-group3.gh (Grasshopper 1.0.7)

brep = Brep(<brep referenced from the Rhino model>)
brep_2 = Brep(<brep referenced from the Rhino model>)
brep_3 = Brep(<brep referenced from the Rhino model>)
brep_4 = Brep(<brep referenced from the Rhino model>)
panel = Panel("""single
wall""")

brep_5 = Brep(<brep referenced from the Rhino model>)
brep_6 = Brep(<brep referenced from the Rhino model>)
brep_7 = Brep(<brep referenced from the Rhino model>)
brep_8 = Brep(<brep referenced from the Rhino model>)
panel_2 = Panel("""duel
wall""")

brep_9 = Brep(<brep referenced from the Rhino model>)
brep_10 = Brep(<brep referenced from the Rhino model>)
panel_3 = Panel("stairs")

brep_11 = Brep(<brep referenced from the Rhino model>)
panel_4 = Panel("""cross
wall""")

brep_12 = Brep(<brep referenced from the Rhino model>)
brep_13 = Brep(<brep referenced from the Rhino model>)
brep_14 = Brep(<brep referenced from the Rhino model>)
brep_15 = Brep(<brep referenced from the Rhino model>)
brep_16 = Brep(<brep referenced from the Rhino model>)
panel_5 = Panel("Types")

point = Point(<point referenced from the Rhino model>)
series = Series(Start=0, Step=Slider(3, range=0..10), Count=Slider(16, range=0..100))
unit_x = UnitX(Factor=series)
move = Move(Geometry=point, Motion=unit_x)  # -> Geometry, Transform

# ----
# The center points of all modules
number_slider = Slider(3, range=0..100)
point_2 = Point(<point referenced from the Rhino model>)
series_2 = Series(Start=0, Step=Slider(12, range=0..20), Count=number_slider)
unit_x_2 = UnitX(Factor=series_2)
move_2 = Move(Geometry=point_2, Motion=unit_x_2)  # -> Geometry, Transform

panel_6 = Panel("Modules")
brep_17 = Brep([<brep referenced from the Rhino model> x10])
brep_18 = Brep([<brep referenced from the Rhino model> x14])
brep_19 = Brep([<brep referenced from the Rhino model> x17])

merge = Merge(Data1=brep_17, Data2=brep_18, Data3=brep_19)
merge_2 = Merge(
    Data1=brep_15,
    Data2=brep_16,
    Data3=brep_12,
    Data4=brep_13,
    Data5=brep_14,
    Data6=brep,
    Data7=brep_2,
    Data8=brep_4,
    Data9=brep_3,
    Data10=brep_8,
    Data11=brep_7,
    Data12=brep_5,
    Data13=brep_6,
    Data14=brep_11,
    Data15=brep_9,
    Data16=brep_10)
ghpython_script = GhPythonScript(run=Toggle(True), output_csv="C:\Users\Biru\Desktop\2023DF\RL-FabDesign\output_100.csv")  # -> out, a
# ---------- ghpython_script: Python ----------
import csv


data = []
with open(output_csv, 'r') as file:
    reader = csv.reader(file)
    next(reader)  # Skip the header
    for row in reader:
        data.append(list(map(int, row)))  # Convert each value to int and append to data

print(data)

a = data
# ---------- end ghpython_script ----------

# ----
# Generating the canvas gird
number_slider_2 = Slider(8, range=0..10)
square = Square(Plane=PlaneXY(0, 0, 0), Size=number_slider_2, ExtentX=Slider(6, range=0..10), ExtentY=Slider(8, range=0..10))  # -> Cells, Points
flip_matrix = FlipMatrix(Data=square.Cells)
area = Area(Geometry=flip_matrix)  # -> Area, flatten(Centroid)
ghpython_script_2 = GhPythonScript(v=ghpython_script.a, x=merge, y=move_2.Geometry, z=area.Centroid, u=Slider(48, range=0..48), w=Slider(32, range=0..100))  # -> a, bath, kitchen, bed, balcony, living; inputs v: list, x: list of Brep, y: list of Point3d, z: list of Point3d, u: Int32, w: Int32
# ---------- ghpython_script_2: Python ----------
__author__ = "AnthemLts"
__version__ = "2023.05.12"

import rhinoscriptsyntax as rs
import ghpythonlib.components as gc
#from Grasshopper.Kernel.Data import GH_Path
#from Grasshopper import DataTree

#generate = v.Branch(GH_Path(int(w)))

generate = v[w % len(v)][1:]
print(generate)
a = []
bath = []
kitchen = []
bed = []
balcony = []
living = []
for i in range(u):
    vec = gc.Vector2Pt(y[int(generate[i])],z[i],False)
    moved = gc.Move(x[generate[i]],vec)[0]
    if generate[i] == 0:
        bath.append(moved)
    elif generate[i] == 1:
        kitchen.append(moved)
    elif generate[i] == 2:
        bed.append(moved)
    elif generate[i] == 3:
        balcony.append(moved)
    elif generate[i] == 4:
        living.append(moved)
    else:
        a.append(moved)
# ---------- end ghpython_script_2 ----------

file_path = FilePath("C:\Users\AnthemLts\Documents\GitHub\RL-FabDesign\output_1000.csv")
ghpython_script_3 = GhPythonScript(run=Toggle(True), output_csv="C:\Users\Biru\Desktop\2023DF\RL-FabDesign\output_100.csv")  # -> out, a; same code as ghpython_script

square_2 = Square(Plane=PlaneXY(0, 0, 0), Size=Slider(1.5, range=0..10), ExtentX=Slider(6, range=0..10), ExtentY=Slider(8, range=0..10))  # -> Cells, Points
flip_matrix_2 = FlipMatrix(Data=square_2.Cells)
area_2 = Area(Geometry=flip_matrix_2)  # -> Area, flatten(Centroid)
ghpython_script_4 = GhPythonScript(
    v=ghpython_script_3.a,
    x=merge_2,
    y=move.Geometry,
    z=area_2.Centroid,
    u=Slider(48, range=0..48),
    w=Slider(31, range=0..100))  # -> a, bath, kitchen, bed, balcony, living; inputs v: list, x: list of Brep, y: list of Point3d, z: list of Point3d, u: Int32, w: Int32; same code as ghpython_script_2

custom_preview = CustomPreview(Geometry=ghpython_script_2.a, Material=ColourSwatch(SwatchColor=RGBA(122, 92, 92, 115)))
custom_preview_2 = CustomPreview(Geometry=ghpython_script_2.bath, Material=ColourSwatch(SwatchColor=RGBA(101, 125, 171, 166)))
custom_preview_3 = CustomPreview(Geometry=ghpython_script_2.kitchen, Material=ColourSwatch(SwatchColor=RGBA(194, 0, 0, 166)))

custom_preview_4 = CustomPreview(Geometry=ghpython_script_4.a, Material=ColourSwatch(SwatchColor=RGBA(122, 92, 92, 115)))
custom_preview_5 = CustomPreview(Geometry=ghpython_script_4.kitchen, Material=ColourSwatch(SwatchColor=RGBA(194, 0, 0, 166)))
custom_preview_6 = CustomPreview(Geometry=ghpython_script_4.bath, Material=ColourSwatch(SwatchColor=RGBA(101, 125, 171, 166)))
custom_preview_7 = CustomPreview(Geometry=ghpython_script_4.bed, Material=ColourSwatch(SwatchColor=RGBA(255, 187, 77, 166)))
custom_preview_8 = CustomPreview(Geometry=ghpython_script_4.balcony, Material=ColourSwatch(SwatchColor=RGBA(145, 242, 136, 166)))
custom_preview_9 = CustomPreview(Geometry=ghpython_script_4.living, Material=ColourSwatch(SwatchColor=RGBA(41, 41, 41, 166)))
custom_preview_10 = CustomPreview(Geometry=ghpython_script_2.bed, Material=ColourSwatch(SwatchColor=RGBA(255, 187, 77, 166)))
custom_preview_11 = CustomPreview(Geometry=ghpython_script_2.balcony, Material=ColourSwatch(SwatchColor=RGBA(145, 242, 136, 166)))
custom_preview_12 = CustomPreview(Geometry=ghpython_script_2.living, Material=ColourSwatch(SwatchColor=RGBA(41, 41, 41, 166)))
