# Grasshopper definition Design_3DVoxel.gh (Grasshopper 1.0.7)

number_slider = Slider(20, range=0..100)
number_slider_2 = Slider(10, range=0..10)
file_path = FilePath("C:\Users\AnthemLts\Documents\GitHub\RL-FabDesign\voxel.csv")
ghpython_script = GhPythonScript(run=Toggle(True), output_csv=file_path)  # -> out, a
# ---------- ghpython_script: Python ----------
import csv


data = []
with open(output_csv, 'r') as file:
    reader = csv.reader(file)
    next(reader)  # Skip the header
    for row in reader:
        data.append(list(map(int, row)))  # Convert each value to int and append to data

print(data)

a = data
# ---------- end ghpython_script ----------
brep = Brep(<brep referenced from the Rhino model>)
volume = Volume(Geometry=brep)  # -> Volume, Centroid

square = Square(Plane=PlaneXY(0, 0, 0), Size=Slider(1.5, range=0..10), ExtentX=number_slider, ExtentY=number_slider_2)  # -> Cells, Points
ghpython_script_2 = GhPythonScript(
    s=brep,
    t=volume.Centroid,
    v=ghpython_script.a,
    x=number_slider,
    y=number_slider_2,
    z=Slider(40, range=0..100),
    u=Slider(48, range=0..48),
    w=Slider(31, range=0..100))  # -> a, fir, sec, thr, fou, fif; inputs s: Brep, t: Point3d, v: list, x: Int32, y: Int32, z: Int32, u: Int32, w: Int32
# ---------- ghpython_script_2: Python ----------
__author__ = "AnthemLts"
__version__ = "2023.05.12"

import rhinoscriptsyntax as rs
import ghpythonlib.components as gc

def get_3d(patterns,ind):
    solid = []
    for i,j in enumerate(patterns):
        if j > 0:
            vol_x = i % 4
            vol_y = (i % 16) // 4
            vol_z = i // 16
            solid.append(gc.ConstructPoint(vol_x*1.5+ind*6,vol_y*1.5,vol_z*1.5))
    
    return solid

fir = []
sec = []
thr = []
fou = []
fif = []

for m,n in enumerate(v):
    voxels = get_3d(n[1:],m)
    for k,f in enumerate(voxels):
        vec = gc.Vector2Pt(t,f,False)
        moved = gc.Move(s,vec)[0]
        if m == 0:
            fir.append(moved)
        elif m == 1:
            sec.append(moved)
        elif m == 2:
            thr.append(moved)
        elif m == 3:
            fou.append(moved)
        elif m == 4:
            fif.append(moved)
# ---------- end ghpython_script_2 ----------

brep_2 = Brep(square.Cells)
custom_preview = CustomPreview(Geometry=ghpython_script_2.a, Material=ColourSwatch(SwatchColor=RGBA(122, 92, 92, 115)))
custom_preview_2 = CustomPreview(Geometry=ghpython_script_2.sec, Material=ColourSwatch(SwatchColor=RGBA(194, 0, 0, 166)))
custom_preview_3 = CustomPreview(Geometry=ghpython_script_2.fir, Material=ColourSwatch(SwatchColor=RGBA(101, 125, 171, 166)))
custom_preview_4 = CustomPreview(Geometry=ghpython_script_2.thr, Material=ColourSwatch(SwatchColor=RGBA(255, 187, 77, 166)))
custom_preview_5 = CustomPreview(Geometry=ghpython_script_2.fou, Material=ColourSwatch(SwatchColor=RGBA(145, 242, 136, 166)))
custom_preview_6 = CustomPreview(Geometry=ghpython_script_2.fif, Material=ColourSwatch(SwatchColor=RGBA(41, 41, 41, 166)))
